# Requirement set Requirement_Set_test (R2021b)
Tesing how the requirement functionality works

## 1 [XW_Power_1] The ECBU SHALL distribute electrical power to individual component loads.. Change

## 2 [#2] Electrical components SHALL be propoerly grounded

### 2.1 [#4] Electrical components SHALL have a resistance from connector to ground of not less than 5mA

## 3 [#3] There SHALL be a means of controlling the ECBU status

## 4 [#6]
Th

## 5 [#7] Their shall be a means to monitor the electrical system